# Grasshopper definition DemoFile.gh (Grasshopper 1.0.7)
# plug-ins: sof_gh_sofistik-2022, BH.UI.Grasshopper

# DemoFile
# The purpose of this file is to demonstrate the core functionalities of bhOwl
io = IO(
    SofistikDocumentProperties_VersionMajor="2022",
    SofistikDocumentProperties_VersionMinor="4",
    SofistikDocumentProperties_VersionName="2022")

circleprofile = CircleProfile(Diameter="0.1", Component="{ .CircleProfile")
material = Material(Name="S235", Density="7850", Component="{ .Material")
# Grasshopper3D to GraphDB
# With the GraphDB Adapter, you can directly upload the created graph file to a local or hosted instance of GraphDB.
panel = Panel("Hohlprofil_100")
constantframingproperty = ConstantFramingProperty(Profile=circleprofile, Material=material, OrientationAngle=0, Name=panel, Component="{ .ConstantFramingProperty")
columns_main_building = Point([Point(67.76803672, 30.38460176, 0), Point(61.13540616, 30.38460176, 0), Point(54.50277559, 30.38460176, 0), Point(47.87014503, 30.38460176, 0), Point(67.76803672, 21.20152552, 0), Point(61.13540616, 21.20152552, 0), Point(54.50277559, 21.20152552, 0), Point(47.87014503, 21.20152552, 0)])
columns_yard = Point([Point(41.23751446, 21.20152552, 0), Point(54.50277559, 14.38383497, 0), Point(47.87014503, 14.38383497, 0), Point(41.23751446, 14.38383497, 0)])
column = Column(BasePoint=columns_yard, Height="0.48", Property=constantframingproperty, Name="yard columns", Component="{ .Column")
column_2 = Column(
    BasePoint=columns_main_building,
    Height="3.75",
    Property=constantframingproperty,
    Name="house columns",
    Component="{ .Column")

# ----
# Rhino Geometry to Graph
# Read me
number_slider = Slider(2, range=0..12)
# Rhino geometry can be converted to a graph by utilizing a Push component along with a TTL adapter and the Rhino objects as inputs.
# Point
pt = ConstructPoint(XCoordinate=number_slider, YCoordinate=Slider(4, range=0..12), ZCoordinate=Slider(9, range=0..12))

# ----
# BHoM and custom classes
number_slider_2 = Slider(5, range=0..10)
# Mesh
msphere = MeshSphere(Base=PlaneXY(0, 0, 0), Radius=Slider(4, range=0..10), UCount=number_slider_2, VCount=number_slider_2)

# ----
# Adapters
# TTL Adapter used for creating TTL files
# GraphDB Adapter used to connect to GraphDB
graphdbadapter = GraphDBAdapter(
    RepositoryName="BHoMGraphDBRepo",
    ServerAddress="http://localhost:7200/",
    GraphName="defaultGraph",
    ClearGraph=False,
    PushTimeoutMillisec=10000,
    Activate=False,
    Component="{ ..ctor")
# Basic Components
ttladapter = TTLAdapter(Component="{ ..ctor")

# ----
# BHoM object
# Custom objects
# Nested objects
panel_2 = Panel("Ludwig Mies van der Rohe")
# Read me
# Read me
crv = Curve(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)
# Here is what an example of the farnsworth house created by Mies van der Rohe converted to a graph would look like. Custom information like the architect have been created as custom objects, while the basic structure of the building like columns, rooms and slabs were created using object already predefined in BHoM.
# Read me
panel_3 = Panel("27. March 1886")
# BH_Owl supports all objects in the BHoM Framework. The corresponding objects and namespaces can be found in BHoM's documentation at Bhom.xyz or by pressing Ctrl + Shift + B and searching for an object directly, as in the example provided here with "Room" from the BH.oM.Architecture.Elements.Room namespace.
room = Room(Perimeter=crv, Component="BH.oM.Architecture.Elements.Room")
architect = CreateCustom(Name=panel_2, Date_of_birth=panel_3, Component="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")
# If an object you want to use doesn't exist yet, you can create it yourself by dragging a "custom object" component from the BHoM Plugin Tab.
panel_4 = Panel(room)
createcustom = CreateCustom(Component="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")
building = CreateCustom(
    name="Farnsworth house",
    yearconstructed="1951",
    site_location="14520 River Rd, Plano, IL 60545, US",
    Component="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")
# You can also create nested structures by combining custom objects with each other, Rhino geometry, or existing BHoM objects.
# Read me
building_2 = CreateCustom(
    name="Farnsworth house",
    yearconstructed="1951",
    site_location="14520 River Rd, Plano, IL 60545, US",
    architect=architect,
    Component="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")

A = Point(Point(9.795000398, -18, 0))
B = Point(Point(16, -8, 0))
C = Point(Point(24, -16, 0))
# Curve
pline = PolyLine(Vertices=[A, B, C], Closed=False)

# ----
# Read me
# GraphDB data local host / non local host
panel_5 = Panel("BHoMOntology")
basicgraphsettings = BasicGraphSettings(
    OntologyTitle=panel_5,
    OntologyDescription="GraphDB examples",
    TBoxURI="https://www.OntologyExample.com",
    ABoxURI="https://www.Individuals.com",
    SerializeGeoToBase64=Toggle(False),
    Component="{ .BasicGraphSettings")

architect_2 = CreateCustom(Name="Ludwig Mies van der Rohe", DateOfBirth="27. March 1886", Component="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")

construction = Construction(Component="{ .Construction")
floor_main_building = Curve(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)
floor_yard = Curve(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)
floor = Floor(Construction=construction, Edges=floor_main_building, Component="{ .Floor")
floor_2 = Floor(Construction=construction, Edges=floor_yard, Component="{ .Floor")

room_2 = Curve(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)
area = Area(Geometry=room_2)  # -> Area, Centroid
room_3 = Room(Perimeter=room_2, Location=area.Centroid, Name="Main Room", Component="BH.oM.Architecture.Elements.Room")

construction_2 = Construction(Component="BH.oM.Physical.Constructions.Construction")
ceiling = Curve(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)
floor_3 = Floor(Construction=construction_2, Edges=ceiling, Component="{ .Floor")

# ----
# Actions
# Plug into
push = Push(
    Adapter=ttladapter,
    PushType="{ \"_t\" : \"System.Enum\", \"TypeName\" : { \"_t\" : \"System.Type\", \"Name\" : \"BH.oM.Adapter.PushType\", \"_bhomVersion\" : \"7.1\" }, \"Value\" : \"AdapterDefault\", \"_bhomVersion\" : \"7.1\" }",
    Active=False,
    Component="{ .Push")  # -> Objects, Success
pull = Pull(
    PullType="{ \"_t\" : \"System.Enum\", \"TypeName\" : { \"_t\" : \"System.Type\", \"Name\" : \"BH.oM.Adapter.PullType\", \"_bhomVersion\" : \"7.1\" }, \"Value\" : \"AdapterDefault\", \"_bhomVersion\" : \"7.1\" }",
    Active=False,
    Component="{ .Pull")

basicgraphsettings_2 = BasicGraphSettings(
    OntologyTitle="PointOntology",
    OntologyDescription="Ontology example with rhino geometry",
    TBoxURI="https://www.OntologyExample.com",
    ABoxURI="https://www.Individuals.com",
    SerializeGeoToBase64=Toggle(False),
    Component="{ .BasicGraphSettings")

# ----
# Toggle me!
toggle = BooleanToggle(False)

crv_2 = Curve(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)
# <https://www.OntologyExample.com/BH.oM.Architecture.Elements.Room>
room_4 = Room(Perimeter=crv_2, Component="BH.oM.Architecture.Elements.Room")
basicgraphsettings_3 = BasicGraphSettings(
    OntologyTitle="PointOntology",
    OntologyDescription="Ontology example with rhino geometry",
    TBoxURI="https://www.OntologyExample.com",
    ABoxURI="https://www.Individuals.com",
    SerializeGeoToBase64=Toggle(False),
    Component="{ .BasicGraphSettings")
graphdbadapter_2 = GraphDBAdapter(
    RepositoryName="BHoM_to_GraphDB",
    ServerAddress="http://www.localhost:7200/",
    GraphName="defaultGraph",
    ClearGraph=Toggle(False),
    PushTimeoutMillisec=10000,
    GraphSettings=basicgraphsettings,
    Activate=toggle,
    Component="{ ..ctor")
# If the TTL Adapter is not provided with a filepath, the resulting graph will not be saved to a file but kept in Grasshopper as a string output.
# Read me
ttladapter_2 = TTLAdapter(GraphSettings=basicgraphsettings_2, Component="{ ..ctor")
ttladapter_3 = TTLAdapter(GraphSettings=basicgraphsettings_3, Component="{ ..ctor")

# ----
# Toggle me!
toggle_2 = BooleanToggle(True)

# ----
# Toggle me!
toggle_3 = BooleanToggle(False)

# ----
# Toggle me!
toggle_4 = BooleanToggle(False)

push_2 = Push(
    Adapter=ttladapter_2,
    Objects=flatten(msphere),
    PushType="{ \"_t\" : \"System.Enum\", \"TypeName\" : { \"_t\" : \"System.Type\", \"Name\" : \"BH.oM.Adapter.PushType\", \"_bhomVersion\" : \"7.1\" }, \"Value\" : \"AdapterDefault\", \"_bhomVersion\" : \"7.1\" }",
    Active=toggle_2,
    Component="{ .Push")  # -> Objects, Success
push_3 = Push(
    Adapter=graphdbadapter_2,
    Objects=flatten(room_4),
    PushType="{ \"_t\" : \"System.Enum\", \"TypeName\" : { \"_t\" : \"System.Type\", \"Name\" : \"BH.oM.Adapter.PushType\", \"_bhomVersion\" : \"7.1\" }, \"Value\" : \"AdapterDefault\", \"_bhomVersion\" : \"7.1\" }",
    Active=toggle_3,
    Component="{ .Push")  # -> Objects, Success
push_4 = Push(
    Adapter=ttladapter_3,
    Objects=flatten(room),
    PushType="{ \"_t\" : \"System.Enum\", \"TypeName\" : { \"_t\" : \"System.Type\", \"Name\" : \"BH.oM.Adapter.PushType\", \"_bhomVersion\" : \"7.1\" }, \"Value\" : \"AdapterDefault\", \"_bhomVersion\" : \"7.1\" }",
    Active=toggle_4,
    Component="{ .Push")  # -> Objects, Success
relay = Relay([architect_2, room_3, floor_3, floor, floor_2, column, column_2])
# The path to the saved file will be displayed in the upper output if the component runs successfully.
# Read me
panel_6 = Panel(push_2.Objects)
panel_7 = Panel(push_2.Success)
panel_8 = Panel(push_4.Objects)
panel_9 = Panel(push_4.Success)
basicgraphsettings_4 = BasicGraphSettings(
    OntologyTitle="BHoMOntology",
    OntologyDescription="Ontology example with BHoM and custom objects",
    TBoxURI="https://www.OntologyExample.com",
    ABoxURI="https://www.Individuals.com",
    SerializeGeoToBase64=Toggle(False),
    Component="{ .BasicGraphSettings")
ttladapter_4 = TTLAdapter(GraphSettings=basicgraphsettings_4, Component="{ ..ctor")

# ----
# Toggle me!
toggle_5 = BooleanToggle(False)

push_5 = Push(
    Adapter=ttladapter_4,
    Objects=flatten(relay),
    PushType="{ \"_t\" : \"System.Enum\", \"TypeName\" : { \"_t\" : \"System.Type\", \"Name\" : \"BH.oM.Adapter.PushType\", \"_bhomVersion\" : \"7.1\" }, \"Value\" : \"AdapterDefault\", \"_bhomVersion\" : \"7.1\" }",
    Active=toggle_5,
    Component="{ .Push")  # -> Objects, Success
panel_10 = Panel(push_5.Objects)
