# Grasshopper definition InstallationFile.gh (Grasshopper 1.0.7)
# plug-ins: sof_gh_sofistik-2022, BH.UI.Grasshopper

# Installation Check
# The purpose of this file is to check for a successfull installation of:
# BHoM and bhOwl
io = IO(
    SofistikDocumentProperties_VersionMajor="2022",
    SofistikDocumentProperties_VersionMinor="4",
    SofistikDocumentProperties_VersionName="2022")
# 2. Check if Plugin works
panel = Panel("testfile.ttl")
# 1. Check for Plugin files
c_script = CSharpScript()  # -> ListOfComponents, InstallSuccessCode
# ---------- c_script: C# ----------
    bool pluginInstalled = false;

    foreach(var objectProxy in Grasshopper.Instances.ComponentServer.ObjectProxies)
    {
      if(Grasshopper.Instances.ComponentServer.FindAssemblyByObject(objectProxy.Guid).Name == "BH.UI.Grasshopper")
      {
        Print("Component: " + objectProxy.Desc.Name);
        Print("   Nick name: " + objectProxy.Desc.NickName);
        Print("   Guid: " + objectProxy.Guid);
        Print("   Library: " + Grasshopper.Instances.ComponentServer.FindAssemblyByObject(objectProxy.Guid).Name);
        Print("   Library id: " + Grasshopper.Instances.ComponentServer.FindAssemblyByObject(objectProxy.Guid).Id);
        Print("   Library version: " + Grasshopper.Instances.ComponentServer.FindAssemblyByObject(objectProxy.Guid).Version);

        pluginInstalled = true;
      }
    }

    InstallSuccessCode = pluginInstalled;
# ---------- end c_script ----------
crv = Curve(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)
# 5
# Lastly toggle to "False" in order to delete the file from your desktop
toggle = BooleanToggle(False)
c_script_2 = CSharpScript(fileName=panel)  # -> A; inputs fileName: String
# ---------- c_script_2: C# usings ----------
using System.IO;
# ---------- c_script_2: C# ----------
    string desktopPath = Environment.GetFolderPath(Environment.SpecialFolder.Desktop);
    A = Path.Combine(desktopPath, fileName);
# ---------- end c_script_2 ----------
area = Area(Geometry=crv)  # -> Area, Centroid
c_script_3 = CSharpScript(filePath=c_script_2, deleteTestFile=toggle)  # -> out, A; inputs filePath: String, deleteTestFile: Boolean
# ---------- c_script_3: C# ----------
    // Check if file exists before deleting
    if (File.Exists(filePath) && deleteTestFile)
    {
      File.Delete(filePath);
    }
# ---------- end c_script_3 ----------
panel_2 = Panel(c_script.ListOfComponents)

# ----
# This should read "True"
# 1
panel_3 = Panel(c_script.InstallSuccessCode)

ttladapter = TTLAdapter(Filepath=c_script_2, Component="{ ..ctor")
room = Room(Perimeter=crv, Location=area.Centroid, Name="Test Room", Component="BH.oM.Architecture.Elements.Room")
# 2
# Toggle to True will create a GraphFile on your Desktop
toggle_2 = BooleanToggle(False)
push = Push(
    Adapter=ttladapter,
    Objects=flatten(room),
    PushType="{ \"_t\" : \"System.Enum\", \"TypeName\" : { \"_t\" : \"System.Type\", \"Name\" : \"BH.oM.Adapter.PushType\", \"_bhomVersion\" : \"7.1\" }, \"Value\" : \"AdapterDefault\", \"_bhomVersion\" : \"7.1\" }",
    Active=toggle_2,
    Component="{ .Push")  # -> Objects, Success
# 4
# Toggle to True will read back the created File, "O" should read back
# a room object as "BH.oM.Architecture.Elements.Room"
toggle_3 = BooleanToggle(False)
panel_4 = Panel(push.Objects)
# 3
# success should read "True"
# You can take a look at the contents of the Graphfile
# in Turtleformat on your Desktop by opening in Editor, Notepad ++, etc.
panel_5 = Panel(push.Success)
fromttl = FromTTL(TTLfilePath=c_script_2, Active=toggle_3, Component="{ .FromTTL")  # -> O, G
panel_6 = Panel(fromttl.O)
